# Grasshopper definition test-net48.gh (Grasshopper 1.0.7)
# plug-ins: MyGrasshopperPlugIn

number_slider = Slider(2, range=1..10)
number_slider_2 = Slider(3, range=1..5)
multiplication = Multiplication(A=number_slider_2, B=number_slider)
test = TestPython(TextToLower="Hello", TextToUpper="World")
python = StartPythonComponent(UserMode="false", StartPython=Toggle(True), LogLevel="Debug", TimeOut=expr("x*1000", "10"))
series = Series(Start=1, Step=1, Count=multiplication)
panel = Panel(series)
panel_2 = Panel(test)
dostuffinpython = ACSharpPythonGrasshopperComponent(AListOfNumbers=panel, RowNumber=number_slider_2, ColumnsNumber=number_slider)
panel_3 = Panel(dostuffinpython)
