# Grasshopper definition test-net7.gh (Grasshopper 1.0.8)
# plug-ins: MyGrasshopperPlugIn

number_slider = Slider(5, range=1..10)
number_slider_2 = Slider(2, range=1..5)
multiplication = Multiplication(A=number_slider_2, B=number_slider)
python = StartPythonComponent(UserMode="false", StartPython=Toggle(True), Level=40000, TimeOut=10000)
series = Series(Start=1, Step=1, Count=multiplication)
test = TestPython(TextToLower="Hello", TextToUpper="World")
panel = Panel(series)
panel_2 = Panel(test)
dostuffinpython = ACSharpPythonGrasshopperComponent(AListOfNumbers=panel, RowNumber=number_slider_2, ColumnsNumber=number_slider)
viewer = ParamViewer(dostuffinpython)
