# Grasshopper definition test.gh (Grasshopper 1.0.7)
# plug-ins: MyGrasshopperPlugIn

colnumber = Slider(5, range=1..10)
rownumber = Slider(2, range=1..10)
start_python = StartPythonComponent(
    StartPython=Toggle(True),
    UserMode=False,
    Level=2147483647,
    TimeOut=10,
    CondaEnvironmentName="myenvironment",
    AnacondaDirectory="C:\Users\Jonas\Anaconda3")
multiply = Multiply(A=rownumber, B=colnumber)
test = TestPython(TextToLower="HELLO", TextToUpper="from python")
list = Panel(multiply)
panel = Panel(rownumber)
panel_2 = Panel(colnumber)
execute_python = APythonConnectedComponent(AListOfNumbers=list, RowNumber=panel, ColumnsNumber=panel_2)
panel_3 = Panel(test)
tree = Panel(execute_python)

# ==== cluster Multiply
A = ClusterInput()
B = ClusterInput()
multiplication = Multiplication(A=A, B=B)
series = Series(Start=1, Step=1, Count=multiplication)
series_2 = ClusterOutput(series)
